# Grasshopper definition AutomaticFacadeBlocks.ghx (Grasshopper 1.0.8)
# plug-ins: Pufferfish

# ---- group: Extra generation of geometry
# 2. Choose extra generation options
offset_for_core_generation_in_meters = Panel("3")
slab_depth_in_meters = Panel("0.3")

# ---- group: Input massing volumes
# Title: Automatic Facade Blocks  v1.2.1
# Meta: Author: Tom Dufficy
# Date: 2025-09-12
# Units: m
# License: MIT (see repo)
# 1. Input base geometry
# IO: Inputs
#   1. Base building masses
#   2. Choice of facade block
# 
# Outputs
# 3. Translated facade block onto massing
# 4. Previews of available blocks
# Notes: Description
# Applies chosen facade block to simple building massings. Intended to add facade options over time across definition versions
# 
# Notes
#   Intended for masterplans & context modelling for visualisations
# Works with flat volumes
# Currently assumes 3m floor-to-floor height, and will try to scale block modules to fill gaps (smaller modules work best - above 4m gets tricky)
# 
# Dependencies
# Rhino 8 (in meters)
# Pufferfish (food4rhino.com/en/app/pufferfish)
geo = Geometry([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])

# ---- group: Facade options / Facade 02
# Changelog: v1.0
# Initial release
# 
# v1.1
# Added automatic scaling of modules to fill gaps
# 
# v1.1.1
# Added brep edges display
# Updated custom preview
# Added note about facade module widths
# 
# v1.2.1
# Correcting missing dependency on Pufferfish
# Added custom height scaling to suit volumes with different heights
# Added example geometry with varied heights
# Added slab and core generation
# Overall cleanup
facade_block_02 = BlockInstance(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)

# ---- group: Facade options / Facade 03
facade_block_03 = BlockInstance(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)

# ---- group: Facade options / Facade 04
facade_block_04 = BlockInstance(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)

# ---- group: Facade options / Facade 05
facade_block_05 = BlockInstance(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)

# ---- group: Facade options / Facade 01
# 2. Choose a facade and connect width
facade_block_01 = BlockInstance(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)

# ---- group: Find top & bottom surfaces of volumes, split curves into sides
debrep = DeconstructBrep(Brep=geo)  # -> Faces, Edges, Vertices
edges = BrepEdges(Brep=geo)  # -> Naked, Interior, NonManifold
area = Area(Geometry=debrep.Faces)  # -> Area, Centroid
pdecon = Deconstruct(Point=area.Centroid)  # -> XComponent, YComponent, ZComponent
sort = SortList(Keys=pdecon.ZComponent, ValuesA=debrep.Faces)  # -> Keys, ValuesA
rev = ReverseList(List=sort.ValuesA)
item = ListItem(List=sort.ValuesA, Index=0, Wrap=True)
item_2 = ListItem(List=rev, Index=0, Wrap=True)
crv = Curve(item)
explode = Explode(Curve=crv, Recursive=True)  # -> Segments, Vertices

# ---- group: Automatically adjust height
bbox = BoundingBox(Content=facade_block_01, Plane=PlaneXY(0, 0, 0))  # -> Box, Box_2
debox = DeconstructBox(Box=bbox.Box)  # -> Plane, X, Y, Z
roundd = RoundToDecimalPlace(NumberX=debox.Y, DecimalPlace=2, RoundType=0)  # -> Rounded, Difference

# ---- group: Automatically adjust width
bbox_2 = BoundingBox(Content=facade_block_01, Plane=PlaneXY(0, 0, 0))  # -> Box, Box_2
debox_2 = DeconstructBox(Box=bbox_2.Box)  # -> Plane, X, Y, Z
roundd_2 = RoundToDecimalPlace(NumberX=debox_2.X, DecimalPlace=2, RoundType=0)  # -> Rounded, Difference

# ---- group: Finding remainder after dividing by distance, distributing across modules, calculating scale factor for facades
num = Number(roundd_2.Rounded)
crv_2 = Curve(explode.Segments)
divlength = DivideLength(Curve=crv_2, Length=num)  # -> Points, Tangents, Parameters
len = Length(Curve=crv_2)
division = Division(A=len, B=num)
expression = Expression(x=division, Expression="floor(x)")
lng = ListLength(List=divlength.Points)  # -> expr("x-1", Length)
multiplication = Multiplication(A=expression, B=num)
trim = TrimTree(Tree=lng, Depth=1)
subtraction = Subtraction(A=len, B=multiplication)
division_2 = Division(A=subtraction, B=trim)
addition = Addition(A=division_2, B=num)
divlength_2 = DivideLength(Curve=crv_2, Length=addition)  # -> Points, Tangents, Parameters
division_3 = Division(A=addition, B=num)

# ---- group: Use top and bottom surfaces to determine height of volumes
area_2 = Area(Geometry=item)  # -> Area, Centroid
area_3 = Area(Geometry=item_2)  # -> Area, Centroid
distance = Distance(PointA=area_3.Centroid, PointB=area_2.Centroid)

# ---- group: Generating cores
offset = OffsetCurve(Curve=item, Distance=expr("-x", offset_for_core_generation_in_meters), Corners=1)
subtraction_2 = Subtraction(A=distance, B=slab_depth_in_meters)
Z = UnitZ(Factor=subtraction_2)
extr = Extrude(Base=offset, Direction=Z)
cap = CapHoles(Brep=extr)

# ---- group: Generating floor slabs
Z_2 = UnitZ(Factor=slab_depth_in_meters)
extr_2 = Extrude(Base=item_2, Direction=expr("-x", Z_2))

# ---- group: Find factor for height multiplication
flatten = FlattenTree(Tree=distance, Path="{0}")
lng_2 = ListLength(List=flatten)
dup = DuplicateData(Data=roundd.Rounded, Number=lng_2, Order=True)
division_4 = Division(A=flatten, B=dup)

# ---- group: Distribute frames and modules along curves and resize
pframe = PerpFrame(Curve=graft(explode.Segments), Parameter=divlength_2.Parameters)
lastdex = LastIndex(List=pframe)
yz = YZPlane(Origin=Point(0, 0, 0))
cull_i = CullIndex(List=pframe, Indices=lastdex, Wrap=True)
orient = Orient(Geometry=facade_block_01, Source=yz, Target=cull_i)  # -> Geometry, Transform
graft = GraftTree(Tree=division_3, IncludeEmptyLists=True, IncludeNullItems=True)
scale_nu = ScaleNU(Geometry=orient.Geometry, Plane=cull_i, ScaleX=1, ScaleY=1, ScaleZ=graft)  # -> Geometry, Transform

# ---- group: Adjust for heights of volumes
trim_2 = TrimTree(Tree=cull_i, Depth=2)
trim_3 = TrimTree(Tree=scale_nu.Geometry, Depth=2)
graft_2 = GraftTree(Tree=division_4, IncludeEmptyLists=True, IncludeNullItems=True)
scale_nu_2 = ScaleNU(Geometry=trim_3, Plane=trim_2, ScaleX=graft_2, ScaleY=1, ScaleZ=1)  # -> Geometry, Transform

# ----
# 4. Bake blocks & extra geometry
block_instances = BlockInstance(scale_nu_2.Geometry)
slabs = Geometry(extr_2)

cores = Geometry(cap)

# ---- group: Custom visual display
preview = CustomPreview(Geometry=slabs, Material=ColourSwatch(SwatchColor=RGB(175, 138, 207)))
preview_2 = CustomPreview(Geometry=block_instances, Material=ColourSwatch(SwatchColor=RGB(138, 194, 207)))
preview_3 = CustomPreview(Geometry=cores, Material=ColourSwatch(SwatchColor=RGB(207, 138, 138)))
